vi "index.gviweb"   [G Web Development Software 22.3.0]
panel controls:
  "Exit (development only)": bool
  "Test Start": bool
  "Test Sequence": T3[]
  "Cancel": bool
  "Simulate Hardware Fault": bool
  "Clear Fault": bool
panel indicators:
  "Total Duration (s)": f64
  "Step Status": T1[]
  "Program Log": string
  "dev status": string
  "Status": string
  "Initialized": bool
  "Finalized": bool
  "Graph": f64[][]
  "Result": bool
types:
  "Color.gtype" = u32
  T1 = cluster{"Progress": f64, "Result": "Color.gtype"}
  T2 = cluster{"Waveform": enum{"Constant", "Sawtooth", "Sinusoid"}, "Amplitude": f64, "Frequency": f64}
  T3 = cluster{"Duration (s)": f64, "Waveform Data": T2, "Fault Probability": f64}
  "Waveforms.gtype" = enum{"Constant", "Sawtooth", "Sinusoid"}
  "IO Data.gtype" = cluster{"Waveform": "Waveforms.gtype", "Duration (s)": f64, "Start Time": timestamp, "Time Factor": f64, "Adjusted Amplitude": f64, "New Wave": bool, "Wave Active": bool, "Fault start time": f64}
  "Step Result.gtype" = enum{"Pass", "Fail", "Canceled"}
  "Step Status.gtype" = cluster{"Progress": f64, "Result": "Step Result.gtype", "Complete": bool}
  "Waveform Data.gtype" = cluster{"Waveform": "Waveforms.gtype", "Amplitude": f64, "Frequency": f64}
  "Test Step Data.gtype" = cluster{"Duration (s)": f64, "Waveform Data": "Waveform Data.gtype", "Fault Probability": f64}
  "Manager State.gtype" = enum{"Idle", "Initialize", "Execute", "Finalize", "Cancel", "HW Fault"}
  "Message Queue Names.gtype" = enum{"Manager", "UI", "IO"}
  "Step Data.gtype" = cluster{"Message Queue": "Message Queue Names.gtype", "Action": string}
  "Sequence.gtype" = cluster{"Manager State": "Manager State.gtype", "Steps": "Step Data.gtype"[]}
  "Manager Data.gtype" = cluster{"Current State": "Manager State.gtype", "Current Step": "Step Data.gtype", "Remaining Steps": "Step Data.gtype"[], "Remaining Sequences": "Sequence.gtype"[], "Current Instruction": string}
  "Error Data.gtype" = cluster{"Error Origin": "Message Queue Names.gtype", "Error In": error}
uses:
  WebApp::support::Message Queue::Create All Message Queues.gvi
  WebApp::support::Message Queue::Dequeue Message.gvi
  WebApp::globals.gviweb
  WebApp::Report Step Complete.gviweb
  WebApp::IO::Handle Next Waveform.gviweb
  WebApp::IO::Generate Waveform.gviweb
  WebApp::IO::Handle Hardware IO.gviweb
  WebApp::debug::Check Test Sequence Complete.gviweb
  NI::G Core::Error::Build Error Cluster.gvi
  WebApp::Monitor Hardware Fault.gviweb
  WebApp::Handle Error.gviweb
  WebApp::Prep Step Staus for Display.gviweb
  WebApp::Calculate Test Duration.gviweb
  WebApp::Validate Test Sequence.gviweb
  WebApp::Handle Data Remaining in Queue.gviweb
  WebApp::Get Result Color.gviweb
  WebApp::Receive IO Data.gviweb
  WebApp::support::Message Queue::Enqueue Message (Single).gvi
  WebApp::UI messages::Append Log Text.gviweb
  WebApp::program sequences::Handle Next Sequence.gviweb
  WebApp::program sequences::Handle Next Step.gviweb
  WebApp::UI messages::Send Sequence Complete UI Updates.gviweb
  WebApp::UI messages::Update Program Status.gviweb
  WebApp::support::Error Handler - Event Handling Loop.gvi
diagram:
  # #debug
  Property Node(instance in=reference to "dev status", "Value"="") -> (error out=w1)
  w2 = bool FALSE  # Stop Event
  Create User Event[EventName="Stop Event"](error in=w1, user event data type=w2) -> (error out=w3, user event out=w4)
  Obtain Queue(element data type=f64[] [], name="output data") -> (queue out=w5)
  # Idle
  #
  # Start Pressed
  #
  # Initializaing
  # 	>> To IO ---Initialize
  # 	Waiting on UI
  # 	>> To UI ---Initialize
  # 	Waiting on IO
  # Executing
  # 	>> To IO ---Execute
  # 	Waiting on IO
  # Finalizing
  # 	>> To IO ---Finalize
  # 	Waiting on IO
  # 	>> To UI ---Finalize
  # 	Waiting on UI
  # Completed
  Build Array("Manager", "UI", "IO") -> w6
  Array Size(array=w6) -> (size(s)=w7)
  call "Create All Message Queues.gvi"(Loop Count=w7, error in=w3) -> (Message Queues=w8, error out=w9)
  Array Index(array=w8) -> (out0[_]=w10, out1[_]=w11, out2[_]=w12)
  s1 = uninitialised  # shift register
  s2 = uninitialised  # shift register
  s3 = uninitialised  # shift register
  while {
    call "Dequeue Message.gvi"(message queue in=w12, timeout in milliseconds=0, error in=w9) -> (timed out?=w13, message queue out=w14, message=w15, message data=w16, error out=w17)
    # UI Update Loop
    case (w15) ignore case {  # Message Cases
      frame "SW Init" {
        w18 = w17
        w19 = default
        w20 = s1
        w21 = FALSE
      }
      frame "Initialize" {
        disable {
          frame Disabled {
            # #Integrate_Hardware
            # Hardware uninitialization goes here
            w22 = w17
          }
          frame Enabled {
            call "globals.gviweb"() -> (Globals=w23)
            Property Node(instance in=w23) -> ("Hardware Initialize Duration (s)"=w24)
            # #debug
            Multiply(w24, 1000) -> w25
            Wait(time to wait=w25)
            w22 = w17
          }
        }
        call "Report Step Complete.gviweb"(Manager Queue=w10, This Queue Name="IO", Step Name=w15, Input_3=w22) -> (Output_2=w18)
        w19 = default
        w20 = s1
        w21 = s3
      }
      frame "Finalize" {
        disable {
          frame Disabled {
            # #Integrate_Hardware
            # Hardware uninitialization goes here
            w26 = w17
          }
          frame Enabled {
            call "globals.gviweb"() -> (Globals=w27)
            Property Node(instance in=w27) -> ("Hardware Finalize Duration (s)"=w28)
            # #debug
            Multiply(w28, 1000) -> w29
            Wait(time to wait=w29)
            w26 = w17
          }
        }
        call "Report Step Complete.gviweb"(Manager Queue=w10, This Queue Name="IO", Step Name=w15, Input_3=w26) -> (Output_2=w18)
        w19 = default
        w20 = s1
        w21 = s3
      }
      frame "Execute" {
        # #todo move some of this functionality to initialization and check if test sequence is empty
        # report empty back to manager
        call "Handle Next Waveform.gviweb"(Test Sequence in=$"Test Sequence", IO Data In=s2) -> (Test Sequence out=w20, IO Data out=w30)
        w18 = w17
        w19 = default
        w21 = s3
      }
      frame "Cancel" {
        sequence {
          frame 0 {
            # Stop IO
            Property Node(instance in=s2, "Wave Active"=FALSE) -> (instance out=w31)
          }
        }
        call "Report Step Complete.gviweb"(Manager Queue=w10, This Queue Name="IO", Step Name=w15, Input_3=w17) -> (Output_2=w18)
        w19 = default
        w20 = s1
        w21 = s3
      }
      frame "Exit" {
        Release Queue(queue=w14) -> (error out=w32)
        Merge Errors(w17, w32) -> (error out=w18)
        w19 = TRUE
        w20 = s1
        w21 = s3
      }
      frame Default {
        case (w13) {
          frame True {
            Property Node(instance in=s2) -> ("Wave Active"=w34, instance out=w35)
            # No message -> handle output
            case (w34) {
              frame False, Default {
                w33 = w35
                w18 = w17
                w20 = s1
              }
              frame True {
                Property Node(instance in=w35) -> ("New Wave"=w36, instance out=w37)
                case (w36) {
                  frame False, Default {
                    w38 = w37
                  }
                  frame True {
                    Get Current Time() -> (current time=w39)
                    # only save init timestamp at wave start
                    Property Node(instance in=w37, "Start Time"=w39, "New Wave"=FALSE) -> (instance out=w38)
                  }
                }
                call "Generate Waveform.gviweb"(IO Data=w38) -> (Time Elapsed=w40, IO data out=w41, Wave Value=w42, Fraction Complete=w43)
                call "Handle Hardware IO.gviweb"(IO data in=w41, Hardware output=w42, Time Elapsed=w40) -> (IO data out=w44, Hardware input=w45)
                call "Check Test Sequence Complete.gviweb"(This Queue Name="IO", Test Sequence in=s1, IO data in=w44, Fraction Complete=w43, Manager Queue=w10) -> (Test Sequence out=w20, IO data out=w33, Fraction Complete (includes messages)=w46)
                Build Array(w46, w42, w45) -> w47
                Enqueue Element(element=w47, error in=w17, queue=w5) -> (error out=w18)
              }
            }
          }
          frame False {
            # Received message
            w48 = "The invalid message string \"%s\" was received in the Message Handling Loop."
            Format Into String(formatString=w48, w15) -> w49
            call "Build Error Cluster.gvi"(code=1, description=w49, error in=w17) -> (error out=w18)
            w33 = s2
            w20 = s1
          }
        }
        w19 = default
        w21 = s3
      }
    }
    call "Monitor Hardware Fault.gviweb"(Manager Queue in=w10, Fault in=w21, Simulate Hardware Fault=$"Simulate Hardware Fault", Error in=w18) -> (Manager Queue out=w50, Fault out=w51, Error out=w52)
    call "Handle Error.gviweb"(Input=w50, Input_2="IO", Output_2=w52) -> (Output_3=w53)
    Wait(time to wait=50)
    next s1 = w20
    next s2 = _
    next s3 = w51
    stop if w19
  }
  s4 = uninitialised  # shift register
  s5 = uninitialised  # shift register
  s6 = uninitialised  # shift register
  s7 = uninitialised  # shift register
  s8 = uninitialised  # shift register
  s9 = uninitialised  # shift register
  while {
    call "Dequeue Message.gvi"(message queue in=w11, timeout in milliseconds=s5, error in=w9) -> (timed out?=w54, message queue out=w55, message=w56, message data=w57, error out=w58)
    # UI Update Loop
    # s9: Step Index
    # s8: Test Steps
    # s5: Dequeue Timeout
    case (w56) ignore case {  # Message Cases
      frame "SW Init" {
        Property Node(instance in=reference to "Result", "Value"=FALSE, "Text"=[" ", " "])
        Property Node(instance in=reference to "Finalized", "Value"=FALSE)
        Property Node(instance in=reference to "Test Sequence", "Disabled"=FALSE)
        Property Node(instance in=reference to "Initialized", "Value"=FALSE, error in=w58) -> (error out=w67, instance out=w68)
        Property Node(instance in=reference to "Status", "Value"="Idle", error in=w58) -> (error out=w69, instance out=w70)
        Property Node(instance in=reference to "Program Log", "Value"="", error in=w58) -> (error out=w71, instance out=w72)
        Build Array(w68, w70, w72) -> w73
        Merge Errors(w67, w69, w71) -> (error out=w74)
        s10 = w74  # shift register
        for {
          w75 = each element of w73
          Close Reference(error in=s10, reference=w75) -> (error out=w76)
          next s10 = w76
        }
        Array Size(array=[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]) -> (size(s)=w65)
        Initialize Array(element="Step Status.gtype" {all zero or empty}, size=w65) -> w64
        call "Prep Step Staus for Display.gviweb"(Steps status out=w64) -> (Step Status=w77)
        Property Node(instance in=reference to "Step Status", "Value"=w77)
        call "Calculate Test Duration.gviweb"(Test Sequences=[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]) -> (Total Duration (s)=w78)
        Property Node(instance in=reference to "Total Duration (s)", "Value"=w78)
        w59 = s10
        w60 = default
        w61 = ""
        w62 = -1
        w63 = f64[][] []
        w66 = 0
      }
      frame "Handle Test Change" {
        Variant To Data(error in (no error)=w58, type="Test Step Data.gtype"[] [], variant=w57) -> (data=w79, error out=w80)
        Array Size(array=w79) -> (size(s)=w65)
        call "Calculate Test Duration.gviweb"(Test Sequences=w79) -> (Total Duration (s)=w81)
        $"Total Duration (s)" <- w81
        call "Validate Test Sequence.gviweb"(Input=reference to "Test Sequence", UI Queue=w55, data=w79, error in=w80) -> (Error out=w59)
        w60 = default
        w61 = s4
        w62 = s5
        w63 = s6
        w64 = s7
        w66 = s9
      }
      frame "Execute" {
        # start polling to process data from IO loop
        call "Report Step Complete.gviweb"(Manager Queue=w10, This Queue Name="UI", Step Name=w56, Input_3=w58) -> (Output_2=w59)
        w60 = default
        w61 = s4
        w62 = 0
        w63 = s6
        w64 = s7
        w65 = s8
        w66 = s9
      }
      frame "Update Status" {
        Variant To Data(error in (no error)=w58, type=string "", variant=w57) -> (data=w82, error out=w59)
        Format Into String(formatString="%s\n%s", s4, w82) -> w61
        $"Program Log" <- w61
        w60 = default
        w62 = s5
        w63 = s6
        w64 = s7
        w65 = s8
        w66 = s9
      }
      frame "Update Program Status" {
        Variant To Data(error in (no error)=w58, type=w56, variant=w57) -> (data=w83, error out=w59)
        $Status <- w83
        w60 = default
        w61 = s4
        w62 = s5
        w63 = s6
        w64 = s7
        w65 = s8
        w66 = s9
      }
      frame "Initialize Complete" {
        $Initialized <- TRUE
        w59 = w58
        w60 = default
        w61 = s4
        w62 = s5
        w63 = s6
        w64 = s7
        w65 = s8
        w66 = s9
      }
      frame "Initialize" {
        Property Node(instance in=reference to "Result", "Value"=FALSE)
        Property Node(instance in=reference to "Test Sequence", "Disabled"=TRUE)
        # Enure at least 1 step is present
        Max And Min(x=s8, y=1) -> (max(x,y)=w84: i32)
        Initialize Array(element="Step Status.gtype" {all zero or empty}, size=w84) -> w64
        call "Prep Step Staus for Display.gviweb"(Steps status out=w64) -> (Step Status=w85)
        Property Node(instance in=reference to "Step Status", "Value"=w85, error in=w58) -> (error out=w86)
        call "Report Step Complete.gviweb"(Manager Queue=w10, This Queue Name="UI", Step Name=w56, Input_3=w86) -> (Output_2=w59)
        w60 = default
        w61 = s4
        w62 = s5
        w63 = f64[][] []
        w65 = s8
        w66 = 0
      }
      frame "Execute Complete" {
        # Handle any data remaining in queue
        call "Handle Data Remaining in Queue.gviweb"(Input_3=reference to "Graph", Input_2=reference to "Step Status", Input_4=w5, Input_5=s9, Input=s6, Input_6=s7, Input_7=w58) -> (Output=w66, Output_3=w63, Output_4=w64, Output_2=w59)
        w60 = default
        w61 = s4
        w62 = s5
        w65 = s8
      }
      frame "Finalize" {
        s11 = "Pass"  # shift register
        for {
          w87 = each element of s7
          Property Node(instance in=w87) -> ("Result"=w88)
          case (s11) {
            frame "Pass", Default {
              w89 = w88
            }
            frame "Fail" {
              case (w88) {
                frame Default {
                  w89 = w88
                }
                frame "Pass" {
                  w89 = s11
                }
              }
            }
            frame "Canceled" {
              w89 = "Canceled"
            }
          }
          next s11 = w89
        }
        call "Get Result Color.gviweb"(Input=s11) -> (Output=w90)
        Format Into String(formatString="%s", s11) -> w91
        Build Array(w91) -> w92
        # stop polling
        Property Node(instance in=reference to "Result", "TrueColor"=w90, "Text"=w92)
        $Result <- TRUE
        Property Node(instance in=reference to "Test Sequence", "Disabled"=TRUE)
        call "Report Step Complete.gviweb"(Manager Queue=w10, This Queue Name="UI", Step Name=w56, Input_3=w58) -> (Output_2=w59)
        w60 = default
        w61 = s4
        w62 = -1
        w63 = s6
        w64 = s7
        w65 = s8
        w66 = s9
      }
      frame "Finalize Complete" {
        $Finalized <- TRUE
        Property Node(instance in=reference to "Test Sequence", "Disabled"=FALSE)
        w59 = w58
        w60 = default
        w61 = s4
        w62 = s5
        w63 = s6
        w64 = s7
        w65 = s8
        w66 = s9
      }
      frame "Cancel" {
        Array Index(array=s7) -> (out0[s9]=w93)
        Property Node(instance in=w93, "Result"="Canceled") -> (instance out=w94)
        Replace Array Subset(inArray=s7, index=s9, new=w94) -> w95
        call "Handle Data Remaining in Queue.gviweb"(Input_3=reference to "Graph", Input_2=reference to "Step Status", Input_4=w5, Input_5=s9, Input=s6, Input_6=w95, Input_7=w58) -> (Output=w66, Output_3=w63, Output_4=w64, Output_2=w96)
        call "Report Step Complete.gviweb"(Manager Queue=w10, This Queue Name="UI", Step Name=w56, Input_3=w96) -> (Output_2=w59)
        w60 = default
        w61 = s4
        w62 = s5
        w65 = s8
      }
      frame "Cancel Complete" {
        w59 = w58
        w60 = default
        w61 = s4
        w62 = s5
        w63 = s6
        w64 = s7
        w65 = s8
        w66 = s9
      }
      frame "Exit" {
        Release Queue(queue=w55) -> (error out=w97)
        Release Queue(queue=w5) -> (error out=w98)
        Merge Errors(w58, w97, w98) -> (error out=w59)
        w60 = TRUE
        w61 = s4
        w62 = s5
        w63 = s6
        w64 = s7
        w65 = s8
        w66 = s9
      }
      frame Default {
        case (w54) {
          frame True {
            Wait(time to wait=500)
            call "Receive IO Data.gviweb"(Test data in=s6, Steps status in=s7, Step Index in=s9, error in=w58, IO Data Queue=w5) -> (Test data out=w63, Steps status out=w64, Step Index out=w66, error out=w59, Test Data for Graph=w99)
            $Graph <- w99
            call "Prep Step Staus for Display.gviweb"(Steps status out=w64) -> (Step Status=w100)
            $"Step Status" <- w100
          }
          frame False {
            w101 = "The invalid message string \"%s\" was received in the Message Handling Loop."
            Format Into String(formatString=w101, w56) -> w102
            call "Build Error Cluster.gvi"(code=1, description=w102, error in=w58) -> (error out=w59)
            w63 = s6
            w64 = s7
            w66 = s9
          }
        }
        w60 = default
        w61 = s4
        w62 = s5
        w65 = s8
      }
    }
    call "Handle Error.gviweb"(Input=w10, Input_2="UI", Output_2=w59) -> (Output_3=w103)
    next s4 = w61
    next s5 = w62
    next s6 = w63
    next s7 = w64
    next s8 = w65
    next s9 = w66
    stop if w60
  }
  # Make list of messages for easy screening
  w104 = [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]  # Instructions
  for {
    w105 = each element of w104
    Property Node(instance in=w105) -> ("Init Info:Instruction"=w107)
    append w107 to w106
  }
  s12 = uninitialised  # shift register
  while {
    call "Dequeue Message.gvi"(message queue in=w10, error in=w9) -> (message queue out=w108, message=w109, message data=w110, error out=w111)
    # Manager Loop
    # w4: Stop Event
    case (w109) ignore case {  # Message Cases
      frame "SW Init" {
        w112 = w111
        w113 = default
        w114 = "Manager Data.gtype" {all zero or empty}
      }
      frame "Test Sequence Change" {
        Array Index(array=w8) -> (out0["UI"]=w115)
        call "Enqueue Message (Single).gvi"(message queue in=w115, message="Handle Test Change", message data=w110, error in=w111) -> (error out=w112)
        w113 = default
        w114 = s12
      }
      frame "Error" {
        Variant To Data(error in (no error)=w111, type="Error Data.gtype" {all zero or empty}, variant=w110) -> (data=w116, error out=w117)
        Property Node(instance in=w116) -> ("Error Origin"=w118, "Error In"=w119)
        Property Node(instance in=w119) -> ("code"=w120, "source"=w121)
        w122 = "================\nError\n\nAt: %s\n\nCode: %d\n%s\n================"
        Format Into String(formatString=w122, errIn=w117, w118, w120, w121) -> (outString=w123, errOut=w124)
        call "Append Log Text.gviweb"(Input=w8, resulting string=w123, error out=w124) -> (Output_2=w112)
        w113 = default
        w114 = s12
      }
      frame "Exit Pressed" {
        # #development
        s13 = w111  # shift register
        for {
          w125 = each element of w8
          call "Enqueue Message (Single).gvi"(message queue in=w125, message="Exit", error in=s13) -> (error out=w126)
          next s13 = w126
        }
        Merge Errors(s13) -> (error out=w112)
        w113 = default
        w114 = s12
      }
      frame "Exit" {
        Generate User Event(event data=TRUE, user event=w4) -> (error out=w127)
        Release Queue(queue=w108) -> (error out=w128)
        Merge Errors(w128, w127) -> (error out=w112)
        w113 = TRUE
        w114 = s12
      }
      frame Default {
        w129 = "The invalid message string \"%s\" was received in the Message Handling Loop."
        # Message undefined
        Format Into String(formatString=w129, w109) -> w130
        call "Build Error Cluster.gvi"(code=1, description=w130, error in=w111) -> (error out=w112)
        w113 = default
        w114 = s12
      }
      frame "Instruction" {
        Variant To Data(error in (no error)=w111, type=w109, variant=w110) -> (data=w131, error out=w132)
        Search 1D Array(1D array=w106, element=w131) -> (index of element=w133)
        case (w133) {
          frame Default {
            # Message in sequence start list -> ensure in valid start state
            Property Node(instance in=s12) -> ("Current State"=w134, instance out=w135)
            Array Index(array=w104) -> (out0[w133]=w136)
            Property Node(instance in=w136) -> ("Init Info:Valid Starts"=w137, instance out=w138)
            Search 1D Array(1D array=w137, element=w134) -> (index of element=w139)
            case (w139) {
              frame Default {
                Format Into String(formatString="******************\nStart: %s\n******************", errIn=w132, w131) -> (outString=w140, errOut=w141)
                call "Append Log Text.gviweb"(Input=w8, resulting string=w140, error out=w141) -> (Output_2=w142)
                Property Node(instance in=w138) -> ("Sequences"=w143)
                # In valid state for recieved message -> react
                call "Handle Next Sequence.gviweb"(manager data in=w135, Sequences=w143, error in=w142, Message Queues=w8) -> (manager data out=w144, Sequence Steps=w145, End Instruction=w146, error out=w147)
                case (w146) {
                  frame True {
                    w148 = "-------------------------------------\nInstruction Sequences Empty\n-------------------------------------"
                    # #verify
                    call "Append Log Text.gviweb"(Input=w8, resulting string=w148, error out=w147) -> (Output_2=w112)
                    w114 = w144
                  }
                  frame False {
                    Property Node(instance in=w144, "Current Instruction"=w131) -> (instance out=w149)
                    call "Handle Next Step.gviweb"(message queues=w8, manager data in=w149, Sequence Steps=w145, Input=w147) -> (manager data out=w114, Output=w112)
                  }
                }
              }
              frame -1 {
                w150 = """-------------------------------------
Received inavalid message for current status

Invalid Message: %s

State: %s
Currently waiting on: %s
-------------------------------------"""
                Property Node(instance in=w135) -> ("Current State"=w151, "Current Step:Message Queue"=w152)
                Format Into String(formatString=w150, errIn=w132, w131, w151, w152) -> (outString=w153, errOut=w154)
                call "Append Log Text.gviweb"(Input=w8, resulting string=w153, error out=w154) -> (Output_2=w112)
                w114 = w135
              }
            }
          }
          frame -1 {
            # Instruction name missing from list
            # Message undefined
            Format Into String(formatString="Instruction \"%s\" undefined.", w109) -> w155
            call "Build Error Cluster.gvi"(code=1, description=w155, error in=w132) -> (error out=w112)
            w114 = s12
          }
        }
        w113 = default
      }
      frame "Step Complete" {
        Property Node(instance in=s12) -> ("Current Step"=w156)
        Variant To Data(error in (no error)=w111, type=w156, variant=w110) -> (data=w157, error out=w158)
        Is Equal[ComparisonMode=CompareAggregates](x=w156, y=w157) -> w159
        case (w159) {
          frame False, Default {
            w112 = w158
            w114 = s12
          }
          frame True {
            Property Node(instance in=s12) -> ("Remaining Steps"=w160, instance out=w161)
            Array Size(array=w160) -> (size(s)=w162)
            Property Node(instance in=w156) -> ("Message Queue"=w163, "Action"=w164)
            Format Into String(formatString="Completed %s %s", errIn=w158, w163, w164) -> (outString=w165, errOut=w166)
            call "Append Log Text.gviweb"(Input=w8, resulting string=w165, error out=w166) -> (Output_2=w167)
            case (w162) {
              frame Default {
                call "Handle Next Step.gviweb"(message queues=w8, manager data in=w161, Sequence Steps=w160, Input=w167) -> (manager data out=w114, Output=w112)
              }
              frame 0 {
                Property Node(instance in=w161) -> ("Remaining Sequences"=w168, "Current State"=w169, instance out=w170)
                call "Send Sequence Complete UI Updates.gviweb"(Current State=w169, Input=w8, Error In=w167) -> (Error out=w171)
                call "Handle Next Sequence.gviweb"(manager data in=w170, Sequences=w168, error in=w171, Message Queues=w8) -> (manager data out=w172, Sequence Steps=w173, End Instruction=w174, error out=w175)
                Property Node(instance in=w172) -> ("Current State"=w176, instance out=w177)
                Format Into String(formatString="%s", errIn=w175, w176) -> (outString=w178, errOut=w179)
                case (w174) {
                  frame False, Default {
                    call "Update Program Status.gviweb"(resulting string=w178, Message Queues=w8) -> (error out=w180)
                    call "Handle Next Step.gviweb"(message queues=w8, manager data in=w177, Sequence Steps=w173, Input=w180) -> (manager data out=w114, Output=w112)
                  }
                  frame True {
                    call "Update Program Status.gviweb"(resulting string=w178, Message Queues=w8, Input=w179) -> (error out=w181)
                    # Instruction complete
                    Property Node(instance in=w177) -> ("Current Instruction"=w182, instance out=w114)
                    Format Into String(formatString="******************\nComplete: %s\n******************", w182) -> w183
                    call "Append Log Text.gviweb"(Input=w8, resulting string=w183, error out=w181) -> (Output_2=w112)
                  }
                }
              }
            }
          }
        }
        w113 = default
      }
    }
    call "Handle Error.gviweb"(Input=w108, Input_2="Manager", Output_2=w112) -> (Output_3=w184)
    next s12 = w114
    stop if w113
  }
  # #todo
  # error handling - display in status log
  # error fault sim
  # be able to clear error with corresponding case in IO
  #
  # create/ configure simulation cases/ flags
  # clean up
  # 	save all text log messages in same place
  # handle error from hardware during initialize or execute
  # 	be able to clear error
  #
  #
  #
  # #additional functionality
  # ---------------------------------
  # add finalize commands
  # 	log data
  # 		with test meta data/ description
  # 	log results
  # cancel
  # abort
  # hardware fault button
  # 	just poll in UI loop?
  # -------------------------------------------------------
  # abort
  # Display test history/ data
  # Pause
  # select between historical data
  # historical analysis/ comparison
  # Splining/ smooth transitions between waveforms
  # unit tests
  # check for empty test sequence
  # force sawtooth to return to 0 before waveform transition?
  # unit tests
  Register For Events("Stop Event"=w4) -> (event registration refnum out=w185)
  s14 = w185  # shift register
  while {
    event (dynamic events = s14) {
      on "Test Start" Value changed {
        # #CodeNeeded - Send the appropriate message for this user interface event.
        call "Enqueue Message (Single).gvi"(message queue in=w10, message="Instruction", message data="Run Test Sequence") -> (message queue out=w188, error out=w187)
        w186 = default
      }
      on "Cancel" Value changed {
        # #CodeNeeded - Send the appropriate message for this user interface event.
        call "Enqueue Message (Single).gvi"(message queue in=w10, message="Instruction", message data="Cancel") -> (message queue out=w188, error out=w187)
        w186 = default
      }
      on "Exit (development only)" Value changed {
        call "Enqueue Message (Single).gvi"(priority message=TRUE, message queue in=w10, message="Exit Pressed") -> (message queue out=w188, error out=w187)
        w186 = default
      }
      on dynamic event 0 {
        # The Message Handling Loop processed an "Exit" message, which fired this event to stop the Event Handling Loop.
        w186 = TRUE
        w187 = default
        w188 = w10
      }
      on "Test Sequence" Value changed {
        Event Data() -> ("New Value"=w189)
        To Variant(anything=w189) -> w190
        call "Enqueue Message (Single).gvi"(message queue in=w10, message="Test Sequence Change", message data=w190) -> (message queue out=w188, error out=w187)
        w186 = default
      }
    }
    call "Error Handler - Event Handling Loop.gvi"(message queue in=w188, error in=w187) -> (dup error in=w191)
    stop if w186
  }
  Unregister For Events(error in=w191, event registration refnum=s14) -> (error out=w192)
  Merge Errors(w192, w184, w103, w53) -> (error out=w193)
  Destroy User Event(error in=w193, user event=w4)
  Property Node(instance in=reference to "Test Sequence", "Value"=[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])
